# Grasshopper definition Chapter3.gh (Grasshopper 1.0.7)

# ---- group: Create new Point
number_slider = Slider(51.27, range=0..100)  # disabled
number_slider_2 = Slider(19.63, range=0..100)  # disabled
number_slider_3 = Slider(79.63, range=0..100)  # disabled
c_script = CSharpScript(x=number_slider_2, y=number_slider, z=number_slider_3)  # -> out, Point; inputs x: Double, y: Double, z: Double; disabled
# ---------- c_script: C# ----------
    //create an instance of a point and initialize to x,y, and z
    Point3d pt = new Point3d (x, y, z);
    
    //assign the point "pt" to output
    Point = pt;
# ---------- end c_script ----------
panel = Panel(c_script.Point)  # disabled

# ---- group: Dissecting the Point, taking out x, y, and z
point = Point(Point(19.63, 51.27, 79.63))  # disabled
c_script_2 = CSharpScript(pt=point)  # -> out, A, B, C; inputs pt: Point3d; disabled
# ---------- c_script_2: C# ----------
    A = pt.X;
    B = pt.Y;
    C = pt.Z;
# ---------- end c_script_2 ----------
panel_2 = Panel(c_script_2.C)  # disabled
panel_3 = Panel(c_script_2.B)  # disabled
panel_4 = Panel(c_script_2.A)  # disabled

# ---- group: Creating vectors and points
c_script_3 = CSharpScript()  # -> out, Point0, Point1, Vector0, Vector1, Dot, subVectors, adVectors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; disabled
# ---------- c_script_3: C# ----------
    Point3d p0 = new Point3d (3, 6, 0);
    Vector3d v0 = new Vector3d (4, 1.5, 0);
    double factor = 0.5;

    Point3d p1 = new Point3d(Point3d.Unset);
    p1 = p0 + v0;

    double distance = p0.DistanceTo(p1);

    Vector3d v1 = new Vector3d (Vector3d.Unset);
    v1 = Point3d.Origin - p0;

    Vector3d addVectors = new Vector3d (Vector3d.Unset);
    addVectors = v0 + v1;

    Vector3d subtractVectors = v0 - v1;

    double dot = v0 * v1;

    Vector3d cross = new Vector3d(Vector3d.Unset);
    cross = Vector3d.CrossProduct(v0, v1);

    Vector3d scalev0 = new Vector3d(Vector3d.Unset);
    scalev0 = v0 * factor;

    double v0Length = v0.Length;

    v0 = new Vector3d(10, 0, 0);
    v1 = new Vector3d(0, 10, 0);

    v0.Unitize();
    v1.Unitize();
    dot = v0 * v1;

    if((dot < -1.0))
      dot = -1.0;
    if((dot > 1.0))
      dot = 1.0;
    double angle = System.Math.Acos(dot);

    Point0 = p0;
    Point1 = p1;
    Vector0 = v0;
    Vector1 = v1;
    Dot = dot;
    subVectors = subtractVectors;
    adVectors = addVectors;
    Cross = cross;
    Scale = scalev0;
    Angle = angle;
# ---------- end c_script_3 ----------
point_2 = Point(c_script_3.Point0)  # disabled
panel_5 = Panel(c_script_3.Dot)  # disabled
vector_display = VectorDisplay(Anchor=point_2, Vector=c_script_3.Vector0)  # disabled
panel_6 = Panel("p0")  # disabled
text_tag = TextTag(Location=point_2, Text=panel_6)  # disabled
vector_display_2 = VectorDisplay(Anchor=point_2, Vector=c_script_3.adVectors)  # disabled
vector_display_3 = VectorDisplay(Anchor=point_2, Vector=c_script_3.Vector1)  # disabled
vector_display_4 = VectorDisplay(Anchor=point_2, Vector=c_script_3.Scale)  # disabled
vector_display_5 = VectorDisplay(Anchor=point_2, Vector=c_script_3.Cross)  # disabled
panel_7 = Panel("p1")  # disabled
text_tag_2 = TextTag(Location=c_script_3.Point1, Text=panel_7)  # disabled
panel_8 = Panel("0,0,0")  # disabled
vector_display_6 = VectorDisplay(Anchor=panel_8, Vector=c_script_3.subVectors)  # disabled

# ---- group: Creating a point and finding the distance of it to another point
point_3 = Point(Point(0, 5, 0))  # disabled
number_slider_4 = Slider(3, range=1..10)  # disabled
number_slider_5 = Slider(2, range=1..10)  # disabled
number_slider_6 = Slider(1, range=1..10)  # disabled
panel_9 = Panel(point_3)  # disabled
c_script_4 = CSharpScript(x=number_slider_6, y=number_slider_5, z=number_slider_4, other=panel_9)  # -> out, Point, Distance; inputs x: Double, y: Double, z: Double, other: Point3d; disabled
# ---------- c_script_4: C# ----------
    Point3d pt = new Point3d(x, y, z);
    double dist = pt.DistanceTo(other);
    Point = pt;
    Distance = dist;
# ---------- end c_script_4 ----------
panel_10 = Panel(c_script_4.Point)  # disabled
panel_11 = Panel(c_script_4.Distance)  # disabled

# ---- group: Creating new Point, first making it null then adding the points in there
number_slider_7 = Slider(3.1, range=0..10)  # disabled
number_slider_8 = Slider(2.1, range=0..10)  # disabled
number_slider_9 = Slider(4.1, range=0..10)  # disabled
c_script_5 = CSharpScript(x=number_slider_8, y=number_slider_7, z=number_slider_9)  # -> out, Point; inputs x: Double, y: Double, z: Double; disabled
# ---------- c_script_5: C# ----------
    //declare a new point
    Point3d newPoint = new Point3d (Point3d.Unset);

    //set "newPoint" coordinates
    newPoint.X = x;
    newPoint.Y = y;
    newPoint.Z = z;

    //assign the point coordinates to output
    Point = newPoint;
# ---------- end c_script_5 ----------
panel_12 = Panel(c_script_5.Point)  # disabled

# ---- group: Get the origin points
c_script_6 = CSharpScript()  # -> out, Origin; disabled
# ---------- c_script_6: C# ----------
    Origin = Point3d.Origin;
# ---------- end c_script_6 ----------
panel_13 = Panel(c_script_6.Origin)  # disabled

# ---- group: Moving point by Transform (Vector3d)
panel_14 = Panel("4,5,6")  # disabled
move = Move(Motion=panel_14)  # -> Geometry, Transform; disabled
point_4 = Point(Point(0, 5, 0))  # disabled
c_script_7 = CSharpScript(Point=point_4, xform=move.Transform)  # -> out, newPt; inputs Point: Point3d, xform: Transform; disabled
# ---------- c_script_7: C# ----------
    Point3d pt = new Point3d(Point);
    pt.Transform(xform);
    newPt = pt;
# ---------- end c_script_7 ----------
panel_15 = Panel(c_script_7.newPt)  # disabled

# ---- group: Changing the value for x in a function
panel_16 = Panel("19")  # disabled
panel_17 = Panel("0")  # disabled
c_script_8 = CSharpScript(x=panel_16, y=panel_17, z=panel_17)  # -> out, Point; inputs x: Double, y: Double, z: Double; disabled
# ---------- c_script_8: C# ----------
    Point3d pt = new Point3d (x, y, z);
    Print("Before the Change.X = " + pt.X);

    ChangeX(pt);

    Print("After the Change.X = " + pt.X);
    Point = pt;
# ---------- c_script_8: C# additional code ----------
  public void ChangeX (Point3d pt){
    pt.X = 100;
    Print("Inside the Change.X =" + pt);
  }
# ---------- end c_script_8 ----------
panel_18 = Panel(c_script_8.out)  # disabled
panel_19 = Panel(c_script_8.Point)  # disabled

# ---- group: Checks if the list of points are co-planar
panel_20 = Panel("""4,5,6
1,1,6
0,0,6""")  # disabled
panel_21 = Panel("0.01")  # disabled
c_script_9 = CSharpScript(pts=panel_20, tolerance=panel_21)  # -> out, IsCoPlanar; inputs pts: list of Point3d, tolerance: Double; disabled
# ---------- c_script_9: C# ----------
    //Test if the list of input points are coplanar
    bool coplaner = Point3d.ArePointsCoplanar(pts, tolerance);
    
    //assign the co-planar test to output
    IsCoPlanar = coplaner;
# ---------- end c_script_9 ----------
panel_22 = Panel(c_script_9.IsCoPlanar)  # disabled

# ---- group: Sums two points together
panel_23 = Panel("1,2,3")  # disabled
panel_24 = Panel("3,2,1")  # disabled
c_script_10 = CSharpScript(pt1=panel_24, pt2=panel_23)  # -> out, sumpt; inputs pt1: Point3d, pt2: Point3d; disabled
# ---------- c_script_10: C# ----------
    sumpt = pt1 + pt2;
# ---------- end c_script_10 ----------
panel_25 = Panel(c_script_10.sumpt)  # disabled

# ----
panel_26 = Panel(c_script_3.Angle)  # disabled

# ---- group: Creating different geometries
c_script_11 = CSharpScript()  # -> out, Line, Polyline
# ---------- c_script_11: C# ----------
    Point3d p0 = new Point3d (0, 0, 0);
    Point3d p1 = new Point3d (5, 1, 0);
    Point3d p2 = new Point3d (6, -3, 0);

    Rhino.Geometry.Line line = new Line (p0, p1);
    Line = line;

    List <Point3d> pts = new List <Point3d> ();
    pts.Add(p0);
    pts.Add(p1);
    pts.Add(p2);

    Rhino.Geometry.Polyline polyline = new Polyline(pts);

    Polyline = polyline;
# ---------- end c_script_11 ----------
line = Line(c_script_11.Line)
curve = Curve(c_script_11.Polyline)

# ----
degrees = Degrees(Radians=panel_26)  # disabled
panel_27 = Panel(degrees)  # disabled
