# Grasshopper definition Chapter4.gh (Grasshopper 1.0.7)

c_script = CSharpScript(num=Slider(45, range=1..100))  # -> out, OutCurves, OutSurface, OutLoft; inputs num: Int32
# ---------- c_script: C# ----------
    //List of all points
    List<Point3d> allPoints = new List<Point3d>();
    //List of curves
    List<Curve> curves = new List<Curve>();

    for(int y = 0; y < num; y++)
    {
      //Curve points
      List<Point3d> crvPoints = new List<Point3d>();
      for(int x = 0; x < num; x++)
      {
        double z = Math.Sin(Math.PI / 180 + (x + y));
        Point3d pt = new Point3d(x, y, z);
        crvPoints.Add(pt);
        allPoints.Add(pt);
      }

      //Create a degree 3 nurbs curve from control points
      Curve crv = Curve.CreateControlPointCurve(crvPoints, 3);
      curves.Add(crv);
    }

    //Create a nurbs surface from control points
    NurbsSurface srf = NurbsSurface.CreateFromPoints(allPoints, num, num, 3, 3);
    //Create a loft brep from curves
    Brep[] breps = Brep.CreateFromLoft(curves, Point3d.Unset, Point3d.Unset, LoftType.Tight, false);

    //Assign the outputs
    OutCurves = curves;
    OutSurface = srf;
    OutLoft = breps;
# ---------- end c_script ----------
